# Grasshopper definition Auditorium_Section.gh (Grasshopper 1.0.8)
# plug-ins: Parakeet

# ----
# EARLY REFLECTION
# CALCULATION
number_slider = Slider(131, range=0..10000)
# SOUND SOURCE
pt = ConstructPoint(XCoordinate=number_slider, YCoordinate=Slider(0, range=0..10000), ZCoordinate=Slider(48, range=0..10000))

# ----
# GALLERY SECTION
# POINT OF PERFORMANCE
number_slider_2 = Slider(131, range=0..1000)
pt_2 = ConstructPoint(XCoordinate=number_slider_2, YCoordinate=0, ZCoordinate=Slider(48, range=-120..120))

crv = Curve(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)

number_slider_3 = Slider(261, range=0..1200)
number_slider_4 = Slider(59, range=-1200..1200)

# ----
# STEP HEIGHT
number_slider_5 = Slider(5, range=-36..36)
# NO. OF ROWS
number_slider_6 = Slider(11, range=0..20)

number_slider_7 = Slider(-1.612, range=-15..15)
number_slider_8 = Slider(2, range=0..10)
number_slider_9 = Slider(-18, range=-30..30)
number_slider_10 = Slider(-18, range=-36..36)
number_slider_11 = Slider(4, range=0..10)
# ERGONOMICS
number_slider_12 = Slider(-6, range=-36..36)

addition = Addition(A=number_slider_3, B=Slider(5, range=-12..12))
subtraction = Subtraction(A=number_slider_4, B=number_slider_11)
pt_3 = ConstructPoint(XCoordinate=number_slider_3, YCoordinate=0, ZCoordinate=number_slider_4)
abs = Absolute(Value=number_slider_9)
crv_2 = Curve(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)
crv_3 = Curve(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)
crv_4 = Curve(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)
crv_5 = Curve(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)
number_slider_13 = Slider(94, range=0..10000)
subtraction_2 = Subtraction(A=number_slider_4, B=number_slider_11, C=abs, D=number_slider_12)
addition_2 = Addition(A=number_slider_3, B=Slider(-2, range=-36..36))
subtraction_3 = Subtraction(A=number_slider_4, B=number_slider_11, C=abs)
xz = XZPlane(Origin=pt_3)
crv_6 = Curve(graft([crv_2, crv_3, crv_4, crv_5]))
pt_4 = ConstructPoint(XCoordinate=number_slider_3, YCoordinate=0, ZCoordinate=subtraction_3)
pt_5 = ConstructPoint(XCoordinate=addition_2, YCoordinate=0, ZCoordinate=subtraction_2)
pt_6 = ConstructPoint(XCoordinate=addition, YCoordinate=0, ZCoordinate=subtraction)
rectangle = Rectangle(Plane=xz, XSize=number_slider_13, YSize=number_slider_13, Radius=0)  # -> Rectangle, Length
xz_2 = XZPlane(Origin=pt_6)
xz_3 = XZPlane(Origin=pt_4)
mirror = MirrorCurve(Geometry=pt, Curve=crv_6, Tangent=True)
end = EndPoints(Curve=crv_6)  # -> Start, End
rectangle_2 = Rectangle(Plane=xz_2, XSize=number_slider_7, YSize=number_slider_9, Radius=number_slider_8)  # -> Rectangle, Length
rectangle_3 = Rectangle(Plane=xz_3, XSize=number_slider_9, YSize=number_slider_7, Radius=number_slider_8)  # -> Rectangle, Length
# SECTION PLANE
xz_4 = XZPlane(Origin=pt)
midpt = CurveMiddle(Curve=crv_6)
area = Area(Geometry=rectangle_3.Rectangle)  # -> Area, Centroid
rectangle_4 = Rectangle(Plane=xz_4, XSize=Slider(607, range=0..3000), YSize=Slider(250, range=0..3000), Radius=0)  # -> Rectangle, Length
ln = Line(StartPoint=mirror, EndPoint=[end.Start, end.End])
abs_2 = Absolute(Value=number_slider_10)
pt_7 = Point(mirror)
pt_8 = Point(midpt)
subtraction_4 = Subtraction(A=number_slider_4, B=number_slider_11, C=abs, D=number_slider_12, E=abs_2)
rad = Radians(Degrees=Slider(-12, range=-360..360))
rad_2 = Radians(Degrees=Slider(-8, range=-360..360))
xz_5 = XZPlane(Origin=area.Centroid)
xz_6 = XZPlane(Origin=pt_5)
extend_cr = ExtendOnSurface(Curve=ln, Surface=rectangle_4.Rectangle)
ln_2 = Line(StartPoint=xz_4, EndPoint=[end.Start, end.End])
points = PointList(Points=flatten(pt_7), Size=Slider(12, range=0..100))
points_2 = PointList(Points=flatten(pt_8), Size=Slider(12, range=0..100))
pt_9 = ConstructPoint(XCoordinate=number_slider_3, YCoordinate=0, ZCoordinate=subtraction_4)
rotate = Rotate(Geometry=rectangle_2.Rectangle, Angle=rad, Plane=xz_2)  # -> Geometry, Transform
rotate_2 = Rotate(Geometry=rectangle_3.Rectangle, Angle=rad_2, Plane=xz_5)  # -> Geometry, Transform
rectangle_5 = Rectangle(Plane=xz_6, XSize=Slider(-10, range=-36..36), YSize=number_slider_10, Radius=0)  # -> Rectangle, Length
# REFLECTIONS
ln_3 = Line(StartPoint=pt_7, EndPoint=pt_8)
number_slider_14 = Slider(-36, range=-60..60)
cir = Circle(Plane=xz, Radius=Slider(2.777, range=0..10))

extend_cr_2 = ExtendOnSurface(Curve=ln_3, Surface=rectangle_4.Rectangle)
preview = CustomPreview(Geometry=ln_2, Material=ColourSwatch(SwatchColor=RGB(222, 210, 47)))
preview_2 = CustomPreview(Geometry=extend_cr, Material=ColourSwatch(SwatchColor=RGB(214, 141, 58)))

area_2 = Area(Geometry=cir)  # -> Area, Centroid
abs_3 = Absolute(Value=number_slider_14)
series = Series(Start=0, Step=number_slider_14, Count=number_slider_6)
multiplication = Multiplication(A=number_slider_5, B=Slider(-1, range=-1..1))
multiplication_2 = Multiplication(A=abs_3, B=2)
Z = UnitZ(Factor=multiplication)
X = UnitX(Factor=number_slider_14)
abs_4 = Absolute(Value=series)
len = Length(Curve=extend_cr_2)  # -> flatten(Length)
X_2 = UnitX(Factor=multiplication_2)
multiplication_3 = Multiplication(A=number_slider_5, B=2)
X_3 = UnitX(Factor=abs_4)
expression = Expression(x=len, Expression="(x*.0254)*1000/342")
move = Move(Geometry=pt_9, Motion=X)  # -> Geometry, Transform
move_2 = Move(Geometry=move.Geometry, Motion=Z)  # -> Geometry, Transform
Z_2 = UnitZ(Factor=multiplication_3)
move_3 = Move(Geometry=area_2.Centroid, Motion=X_2)  # -> Geometry, Transform
series_2 = Series(Start=0, Step=number_slider_5, Count=number_slider_6)
ln_4 = Line(StartPoint=move.Geometry, EndPoint=move_2.Geometry)
ln_5 = Line(StartPoint=pt_9, EndPoint=move.Geometry)
# SINGLE
# SITTING
geo = Geometry(flatten([cir, rotate.Geometry, rotate_2.Geometry, rectangle_5.Rectangle, pt_9, ln_5, ln_4]))
move_4 = Move(Geometry=graft(geo), Motion=X_3)  # -> Geometry, Transform
first_reflection_ms = Panel(expression)
move_5 = Move(Geometry=move_3.Geometry, Motion=Z_2)  # -> Geometry, Transform
Z_3 = UnitZ(Factor=series_2)
# SECTION
move_6 = Move(Geometry=move_4.Geometry, Motion=Z_3)  # -> Geometry, Transform

# ----
# VISUAL
# CONNECTIVITY
ln_6 = Line(StartPoint=pt_2, EndPoint=move_5.Geometry)
ln_7 = Line(StartPoint=pt_2, EndPoint=area_2.Centroid)

pshift = ShiftPaths(Data=move_6.Geometry, Offset=Slider(1, range=-8..2))
flip = FlipMatrix(Data=pshift)
item = ListItem(List=flip, Index=Slider(5, range=0..10), Wrap=True)  # -> Item, Item1
join = JoinCurves(Curves=flatten([item.Item, item.Item1]), Preserve=False)
arrcurve = CurveArray(Geometry=graft(geo), Curve=flatten(crv), Count=Slider(23, range=0..100))  # -> Geometry, Transform
# GALLERY
swp1 = Sweep1(Rail=crv, Sections=join, Miter=0)
